# Grasshopper definition BareHull.gh (Grasshopper 1.0.7)

point = Point([<point referenced from the Rhino model> x248])
interpolate = Interpolate(Vertices=point, Degree=3, Periodic=False, KnotStyle=1)  # -> Curve, Length, Domain
x_axis = Line(Line((20, 0, 0), (0, 0, 0)))
curve = Curve(interpolate.Curve)
revolution = Revolution(Curve=curve, Axis=x_axis, Domain=Domain(0, 6.283185307))
hull_surface = Surface(revolution)
