# Grasshopper definition SailSide.gh (Grasshopper 1.0.7)

point = Point([<point referenced from the Rhino model> x366])
number_slider = Slider(0, range=0..1)
deconstruct = Deconstruct(Point=point)  # -> XComponent, YComponent, ZComponent
equality = Equality(FirstNumber=deconstruct.ZComponent, SecondNumber=number_slider)  # -> Equality, Inequality
cull_pattern = CullPattern(List=point, CullPattern=equality.Equality)
cull_pattern_2 = CullPattern(List=point, CullPattern=equality.Inequality)
point_2 = Point(cull_pattern)
point_3 = Point(cull_pattern_2)
interpolate = Interpolate(Vertices=point_3, Degree=3, Periodic=False, KnotStyle=1)  # -> Curve, Length, Domain
interpolate_2 = Interpolate(Vertices=point_2, Degree=3, Periodic=False, KnotStyle=1)  # -> Curve, Length, Domain
curve = Curve(interpolate.Curve)
curve_2 = Curve(interpolate_2.Curve)
curve_3 = Curve([curve, curve_2])
loft = Loft(Curves=curve_3, Options={Adjust=False, Closed=False, LoftEnds=0, LoftSimp=0, LoftType=0, Rebuild=10, Refit=0.01})
sailside = Surface(loft)
